# Dynamo graph DisenoVial_AutomatizacionCompleta.dyn (Dynamo 3.5.2.8914)
# Automatizacion diseno vial Civil 3D 2026

capa_eje_de_camino = StringInput("EJE DE CAMINO")
nombre_alineamiento = StringInput("ALI-EJE")
paso_1_crear_alineamiento = Python(IN[0]=capa_eje_de_camino, IN[1]=nombre_alineamiento)  # IronPython2
# ---------- paso_1_crear_alineamiento.python (137 lines) ----------
# PASO 1: Alineamiento desde polilinea (SELECCION AUTOMATICA)
# Ya NO depende del nombre de capa:
#  - 1 polilinea  -> se usa esa
#  - varias       -> se usa la MAS LARGA (tipico eje de camino)
#  - si hay match con la capa indicada (opcional), esa tiene prioridad
# layerId se pasa como ObjectId (la API no acepta string).
# OUT = [alignment_id, [log...]]
import clr, math
clr.AddReference('AcMgd'); clr.AddReference('AcDbMgd'); clr.AddReference('AeccDbMgd')
from Autodesk.AutoCAD.ApplicationServices import Application
from Autodesk.AutoCAD.DatabaseServices import *
from Autodesk.AutoCAD.Geometry import Point3d
from Autodesk.Civil.ApplicationServices import CivilApplication
from Autodesk.Civil.DatabaseServices import Alignment

layer_name = IN[0]   # opcional: si coincide, prioriza esa polilinea
ali_name   = IN[1]
DEST_LAYER = 'C-ROAD-CNTR'
doc  = Application.DocumentManager.MdiActiveDocument
db   = doc.Database
cdoc = CivilApplication.ActiveDocument

def norm(s):
    import unicodedata
    return ''.join(c for c in unicodedata.normalize('NFD', unicode(s))
                   if unicodedata.category(c) != 'Mn').upper()

def sty(col, *ns):
    for n in ns:
        try: return col[n]
        except: pass
    for s in col: return s
    return ObjectId.Null

def plen(obj):
    try:
        return float(obj.Length)
    except:
        try:
            e = obj.GeometricExtents
            dx = e.MaxPoint.X - e.MinPoint.X
            dy = e.MaxPoint.Y - e.MinPoint.Y
            return math.sqrt(dx*dx + dy*dy)
        except:
            return 0.0

def get_layer_id(tr, name):
    lt = tr.GetObject(db.LayerTableId, OpenMode.ForRead)
    if lt.Has(name):
        return lt[name]
    lt.UpgradeOpen()
    ltr = LayerTableRecord(); ltr.Name = name
    lid = lt.Add(ltr)
    tr.AddNewlyCreatedDBObject(ltr, True)
    return lid

try:
    tgt = norm(layer_name) if layer_name else None
    cands = []          # [(oid, length, layer)]
    by_layer = None
    with doc.LockDocument():
        with db.TransactionManager.StartTransaction() as tr:
            bt  = tr.GetObject(db.BlockTableId, OpenMode.ForRead)
            btr = tr.GetObject(bt[BlockTableRecord.ModelSpace], OpenMode.ForRead)
            for oid in btr:
                obj = tr.GetObject(oid, OpenMode.ForRead)
                if isinstance(obj, (Polyline, Polyline2d, Polyline3d)):
                    L = plen(obj)
                    cands.append((oid, L, obj.Layer))
                    if tgt and norm(obj.Layer) == tgt and by_layer is None:
                        by_layer = (oid, L, obj.Layer)
            tr.Commit()

    if not cands:
        raise ValueError(u'No hay ninguna polilinea en el modelo.')

    if by_layer is not None:
        pid, plong, play = by_layer
        sel = u"capa '" + str(play) + u"'"
    elif len(cands) == 1:
        pid, plong, play = cands[0]
        sel = u"unica polilinea (capa '" + str(play) + u"')"
    else:
        cands.sort(key=lambda c: c[1], reverse=True)
        pid, plong, play = cands[0]
        sel = (u"mas larga de " + str(len(cands)) +
               u" (L=%.2f m, capa '%s')" % (plong, play))

    ast = sty(cdoc.Styles.AlignmentStyles, 'Standard', u'Est\xe1ndar', 'Estandar')
    lst = sty(cdoc.Styles.LabelSetStyles.AlignmentLabelSetStyles, 'Standard', '_No Labels')
    aid = None
    msg = u''
    with doc.LockDocument():
        with db.TransactionManager.StartTransaction() as tr:
            layer_id = get_layer_id(tr, DEST_LAYER)
            try:
                aid = Alignment.CreateFromPolyline(cdoc, ali_name, ObjectId.Null,
                          pid, layer_id, ast, lst, False, True)
                msg = u'[OK P1] Alineamiento creado (arcos preservados). Polilinea: ' + sel
                tr.Commit()
            except Exception as e:
                tr.Abort()
                msg = u'[WARN P1] CreateFromPolyline fallo: ' + str(e) + u' -> manual. Polilinea: ' + sel
                with doc.LockDocument():
                    with db.TransactionManager.StartTransaction() as t2:
                        lid2 = get_layer_id(t2, DEST_LAYER)
                        pl = t2.GetObject(pid, OpenMode.ForRead)
                        aid = Alignment.Create(cdoc, ali_name, ObjectId.Null,
                                               lid2, ast, lst)
                        ents = t2.GetObject(aid, OpenMode.ForWrite).Entities
                        nv = pl.NumberOfVertices
                        rng = range(nv) if pl.Closed else range(nv - 1)
                        for i in rng:
                            j = (i + 1) % nv
                            p1 = pl.GetPoint3dAt(i); p2 = pl.GetPoint3dAt(j)
                            bv = pl.GetBulgeAt(i)
                            if abs(bv) < 1e-12:
                                ents.AddFixedLine(Point3d(p1.X,p1.Y,0.0),
                                                  Point3d(p2.X,p2.Y,0.0))
                            else:
                                t = 4.0*math.atan(abs(bv))
                                d = math.sqrt((p2.X-p1.X)**2+(p2.Y-p1.Y)**2)
                                r = d/(2.0*math.sin(t/2.0))
                                mx,my = (p1.X+p2.X)/2.0,(p1.Y+p2.Y)/2.0
                                dm = math.sqrt(max(0.0, r*r-(d/2.0)**2))
                                ca = math.atan2(p2.Y-p1.Y, p2.X-p1.X)
                                cw = bv < 0
                                pp = ca + (math.pi/2.0 if not cw else -math.pi/2.0)
                                c = Point3d(mx+dm*math.cos(pp), my+dm*math.sin(pp), 0.0)
                                sa = math.atan2(p1.Y-c.Y, p1.X-c.X)
                                ea = math.atan2(p2.Y-c.Y, p2.X-c.X)
                                ents.AddFixedArc(c, r, sa, ea, cw)
                        t2.Commit()
                        msg += u' Alineamiento manual OK.'
    OUT = [aid, [msg]]
except Exception as ex:
    OUT = [None, [u'[ERROR P1] ' + str(ex)]]
# ----------------------------------------
nombre_rasante = StringInput("RASANTE")
nombre_assembly = StringInput("camino")
nombre_superficie_tn = StringInput("TN")
nombre_superficie_sello = StringInput("SELLO")
delta_metros = DoubleInput(0.3)
paso_2_crear_sello = Python(IN[0]=nombre_superficie_tn, IN[1]=nombre_superficie_sello, IN[2]=delta_metros, IN[3]=paso_1_crear_alineamiento)  # IronPython2
# ---------- paso_2_crear_sello.python (64 lines) ----------
# PASO 2: SELLO = TN - delta
# IN[0]=tn IN[1]=sello IN[2]=delta IN[3]=salida_P1 [aid,[logs]]
# OUT = [sello_id, tn_id, logs_acumulados]
import clr
clr.AddReference('AcMgd'); clr.AddReference('AcDbMgd'); clr.AddReference('AeccDbMgd')
from Autodesk.AutoCAD.ApplicationServices import Application
from Autodesk.AutoCAD.DatabaseServices import *
from Autodesk.AutoCAD.Geometry import Point3d, Point3dCollection
from Autodesk.Civil.ApplicationServices import CivilApplication
from Autodesk.Civil.DatabaseServices import TinSurface

tn_name    = IN[0]
sello_name = IN[1]
delta      = float(IN[2])
p1 = IN[3]
logs = list(p1[1]) if (p1 and len(p1) > 1 and p1[1]) else []
doc  = Application.DocumentManager.MdiActiveDocument
db   = doc.Database
cdoc = CivilApplication.ActiveDocument

def find_surf(name):
    for sid in cdoc.GetSurfaceIds():
        with db.TransactionManager.StartTransaction() as tr:
            s = tr.GetObject(sid, OpenMode.ForRead); tr.Commit()
            if s.Name.upper() == name.upper(): return sid
    return None

def sty(col, *ns):
    for n in ns:
        try: return col[n]
        except: pass
    for s in col: return s
    return ObjectId.Null

try:
    if p1 is None or p1[0] is None:
        OUT = [None, None, logs + [u'[SKIP P2] PASO 1 sin alineamiento.']]
    else:
        tn_id = find_surf(tn_name)
        if tn_id is None:
            raise ValueError(u'Superficie TN no encontrada: ' + tn_name)
        ex = find_surf(sello_name)
        if ex is not None:
            with doc.LockDocument():
                with db.TransactionManager.StartTransaction() as tr:
                    tr.GetObject(ex, OpenMode.ForWrite).Erase(); tr.Commit()
        st = sty(cdoc.Styles.SurfaceStyles, 'Standard', u'Est\xe1ndar', 'Estandar')
        with doc.LockDocument():
            with db.TransactionManager.StartTransaction() as tr:
                tn  = tr.GetObject(tn_id, OpenMode.ForRead)
                pts = Point3dCollection()
                for v in tn.Vertices:
                    L = v.Location
                    pts.Add(Point3d(L.X, L.Y, L.Z - delta))
                sid = TinSurface.Create(cdoc, sello_name)
                srf = tr.GetObject(sid, OpenMode.ForWrite)
                if st != ObjectId.Null: srf.StyleId = st
                srf.AddVertices(pts)
                srf.Rebuild()
                tr.Commit()
        logs.append(u'[OK P2] SELLO = TN - %.3f m (%d vert.)' % (delta, pts.Count))
        OUT = [sid, tn_id, logs]
except Exception as ex:
    OUT = [None, None, logs + [u'[ERROR P2] ' + str(ex)]]
# ----------------------------------------
paso_3_vista_de_perfil = Python(IN[0]=paso_1_crear_alineamiento, IN[1]=paso_2_crear_sello)  # IronPython2
# ---------- paso_3_vista_de_perfil.python (60 lines) ----------
# PASO 3: Vista de perfil con TN y SELLO
# IN[0]=salida_P1 IN[1]=salida_P2 ; OUT=[pv_id, logs_acumulados]
import clr
clr.AddReference('AcMgd'); clr.AddReference('AcDbMgd'); clr.AddReference('AeccDbMgd')
from Autodesk.AutoCAD.ApplicationServices import Application
from Autodesk.AutoCAD.DatabaseServices import *
from Autodesk.AutoCAD.Geometry import Point3d
from Autodesk.Civil.ApplicationServices import CivilApplication
from Autodesk.Civil.DatabaseServices import Profile, ProfileView

p1 = IN[0]
p2 = IN[1]
logs = list(p2[2]) if (p2 and len(p2) > 2 and p2[2]) else []
doc  = Application.DocumentManager.MdiActiveDocument
db   = doc.Database
cdoc = CivilApplication.ActiveDocument

def sty(col, *ns):
    for n in ns:
        try: return col[n]
        except: pass
    for s in col: return s
    return ObjectId.Null

def surf_profile(tr, ali_id, surf_id, name, layer_oid):
    ali = tr.GetObject(ali_id, OpenMode.ForRead)
    for pid in ali.GetProfileIds():
        if tr.GetObject(pid, OpenMode.ForRead).Name == name:
            return pid
    ps = sty(cdoc.Styles.ProfileStyles, 'Standard', u'Est\xe1ndar', 'Estandar')
    ls = sty(cdoc.Styles.LabelSetStyles.ProfileLabelSetStyles, '_No Labels', 'Standard')
    return Profile.CreateFromSurface(name, ali_id, surf_id, layer_oid, ps, ls)

try:
    if p1 is None or p1[0] is None:
        OUT = [None, logs + [u'[SKIP P3] PASO 1 sin alineamiento.']]
    elif p2 is None or p2[0] is None:
        OUT = [None, logs + [u'[SKIP P3] PASO 2 sin SELLO.']]
    else:
        alignment_id = p1[0]
        sello_id     = p2[0]
        tn_id        = p2[1]
        pvs = sty(cdoc.Styles.ProfileViewStyles, 'Standard', u'Est\xe1ndar', 'Estandar')
        with doc.LockDocument():
            with db.TransactionManager.StartTransaction() as tr:
                ali = tr.GetObject(alignment_id, OpenMode.ForRead)
                ext = ali.GeometricExtents
                ins = Point3d(ext.MaxPoint.X + 150.0, ext.MinPoint.Y, 0.0)
                cl  = db.Clayer
                surf_profile(tr, alignment_id, tn_id,    u'PERF-TN',    cl)
                surf_profile(tr, alignment_id, sello_id, u'PERF-SELLO', cl)
                pv_id = ProfileView.Create(alignment_id, ins)
                pv = tr.GetObject(pv_id, OpenMode.ForWrite)
                pv.Name = u'PV-EJE'
                if pvs != ObjectId.Null: pv.StyleId = pvs
                tr.Commit()
        logs.append(u'[OK P3] Vista de perfil PV-EJE con TN y SELLO.')
        OUT = [pv_id, logs]
except Exception as ex:
    OUT = [None, logs + [u'[ERROR P3] ' + str(ex)]]
# ----------------------------------------
paso_4_crear_corredor = Python(IN[0]=paso_1_crear_alineamiento, IN[1]=nombre_rasante, IN[2]=nombre_assembly, IN[3]=paso_2_crear_sello, IN[4]=paso_3_vista_de_perfil)  # IronPython2
# ---------- paso_4_crear_corredor.python (86 lines) ----------
# PASO 4: Corredor con rasante existente y assembly "camino"
# IN[0]=salida_P1 IN[1]=rasante IN[2]=assembly IN[3]=salida_P2 IN[4]=salida_P3
# OUT=[corridor_id, logs_acumulados_de_los_4_pasos]
import clr
clr.AddReference('AcMgd'); clr.AddReference('AcDbMgd'); clr.AddReference('AeccDbMgd')
from Autodesk.AutoCAD.ApplicationServices import Application
from Autodesk.AutoCAD.DatabaseServices import *
from Autodesk.Civil.ApplicationServices import CivilApplication
from Autodesk.Civil.DatabaseServices import Corridor

p1 = IN[0]
profile_name  = IN[1]
assembly_name = IN[2]
p2 = IN[3]
p3 = IN[4]
logs = list(p3[1]) if (p3 and len(p3) > 1 and p3[1]) else []
doc  = Application.DocumentManager.MdiActiveDocument
db   = doc.Database
cdoc = CivilApplication.ActiveDocument

def sty(col, *ns):
    for n in ns:
        try: return col[n]
        except: pass
    for s in col: return s
    return ObjectId.Null

def find_profile(ali_id, name):
    with db.TransactionManager.StartTransaction() as tr:
        ali = tr.GetObject(ali_id, OpenMode.ForRead)
        found, names = None, []
        for pid in ali.GetProfileIds():
            p = tr.GetObject(pid, OpenMode.ForRead)
            names.append(p.Name)
            if p.Name.upper() == name.upper(): found = pid
        tr.Commit()
    return found, names

def find_assembly(name):
    import unicodedata
    def n(s):
        return ''.join(c for c in unicodedata.normalize('NFD', unicode(s))
                       if unicodedata.category(c) != 'Mn').upper()
    tgt = n(name)
    with db.TransactionManager.StartTransaction() as tr:
        for aid in cdoc.GetAssemblyIds():
            if n(tr.GetObject(aid, OpenMode.ForRead).Name) == tgt:
                tr.Commit(); return aid
        tr.Commit()
    return None

try:
    if p1 is None or p1[0] is None:
        OUT = [None, logs + [u'[SKIP P4] PASO 1 sin alineamiento.']]
    elif p3 is None or p3[0] is None:
        OUT = [None, logs + [u'[SKIP P4] PASO 3 sin vista de perfil.']]
    else:
        alignment_id = p1[0]
        prof_id, avail = find_profile(alignment_id, profile_name)
        if prof_id is None:
            raise ValueError(u'Rasante no encontrada: ' + profile_name +
                             u'. Disponibles: ' + str(avail))
        asm_id = find_assembly(assembly_name)
        if asm_id is None:
            raise ValueError(u'Assembly no encontrado: ' + assembly_name)
        cst = sty(cdoc.Styles.CorridorStyles, 'Standard', u'Est\xe1ndar', 'Estandar')
        with doc.LockDocument():
            with db.TransactionManager.StartTransaction() as tr:
                ali = tr.GetObject(alignment_id, OpenMode.ForRead)
                s0, s1 = ali.StartingStation, ali.EndingStation
                cor_id = Corridor.Create(cdoc, u'CORREDOR-EJE')
                cor = tr.GetObject(cor_id, OpenMode.ForWrite)
                if cst != ObjectId.Null: cor.StyleId = cst
                bl  = cor.Baselines.Add(u'BL-EJE', alignment_id, prof_id)
                reg = bl.BaselineRegions.Add(u'REG-1', asm_id)
                try:
                    reg.StartStation = s0
                    reg.EndStation   = s1
                except: pass
                cor.Rebuild()
                tr.Commit()
        logs.append(u'[OK P4] Corredor: assembly=' + assembly_name +
                    u', rasante=' + profile_name)
        OUT = [cor_id, logs]
except Exception as ex:
    OUT = [None, logs + [u'[ERROR P4] ' + str(ex)]]
# ----------------------------------------
watch_resultado = Watch(paso_4_crear_corredor)
